# Grasshopper definition DeformedRing.gh (Grasshopper 1.0.8)
# plug-ins: Kangaroo2 Components

width = GetInteger(Slider(54, range=0..100), AtLeast=1, AtMost=1, Maximum=2147483647, Minimum=-2147483648, TreeAccess=False)
length = GetInteger(
    Slider(61, range=0..100),
    AtLeast=1,
    AtMost=1,
    Maximum=2147483647,
    Minimum=-2147483648,
    Prompt="Length",
    TreeAccess=False)
heigth = GetInteger(Slider(78, range=0..100), AtLeast=1, AtMost=1, Maximum=2147483647, Minimum=-2147483648, TreeAccess=False)
pointnumber = GetInteger(Slider(6, range=0..10), AtLeast=1, AtMost=1, Maximum=2147483647, Minimum=-2147483648, TreeAccess=False)
size = GetNumber(Slider(2, range=0..2), AtLeast=1, AtMost=1, Maximum=1.797693135e+308, Minimum=-1.797693135e+308, TreeAccess=False)
center_box = CenterBox(Base=PlaneXY(0, 0, 0), X=width, Y=length, Z=heigth)
populate_3d = Populate3D(Region=center_box, Count=pointnumber, Seed=1)
boolean_toggle = BooleanToggle(True)
partition_list = PartitionList(List=populate_3d, Size=2)
relative_item = RelativeItem(Tree=simplify(partition_list), Offset="{1}(1)", WrapPaths=boolean_toggle, WrapItems=boolean_toggle)  # -> ItemA, ItemB
line = Line(StartPoint=relative_item.ItemA, EndPoint=relative_item.ItemB)  # -> flatten(Line)
multipipe = MultiPipe(
    Curves=line,
    NodeSize=Slider(1, range=0..10),
    EndOffset=Slider(0, range=0..100),
    StrutSize=size,
    Segment=0,
    KinkAngle=0.6,
    CubeFit=0,
    Caps="1")
subd = SubD(multipipe)
context_bake = ContextBake(Geometry=subd)
